vi "Setup ADC Characterisation.gvi"   [LabVIEW NXG 5.0.0]
inputs:
  "ADC Drivers": "ADC Drivers.gtype"
  "Logical Instrument": string = "ADC1"
  "Start Volts": f32
  "Error in": error
  "Increment": f32
  "End Volts": f32
outputs:
  "ExecutableDirector": "ExecutableDirector.gtype"  # Configured Executable Director (execute once) capable of running the necessary commands.
  "DMM MEAS Id": string  # The ID of the the *IDN? Executable which will be used to identify an incoming result.
  "Error Out": error
  "ADC MEAS Id": string  # The ID of the the *IDN? Executable which will be used to identify an incoming result.
types:
  "ADC Drivers.gtype" = cluster{"HMC8043 Driver": "Driver.gtype", "DMM6500 Driver": "Driver.gtype", "ICB Driver": "Driver.gtype"}
uses:
  Hardware Abstraction Framework::Command::SCPI Generic::User Defined Read.gtype::Write Command to Execute.gvi
  Hardware Abstraction Framework::Common::WriteExecutable.gtype::Read Id.gvi
  Hardware Abstraction Framework::Common::WriteExecutable.gtype::Write Driver.gvi
  Hardware Abstraction Framework::Command::SCPI Acquire::Measure.gtype::Configure.gvi
  Hardware Abstraction Framework::Support::Helpers::Parameter Builder.gvi
  Hardware Abstraction Framework::Common::WriteExecutable.gtype::Write Parameters.gvi
  Hardware Abstraction Framework::Command::SCPI Generate::Voltage.gtype::Write Volts.gvi
  Hardware Abstraction Framework::Command::SCPI Generate::Voltage.gtype::Write Increment.gvi
  Hardware Abstraction Framework::Common::RepeatingDirector.gtype::Write Times Repeat.gvi
  Hardware Abstraction Framework::Common::ExecutableDirector.gtype::Write Wait Time.gvi
  Hardware Abstraction Framework::Common::ExecutableDirector.gtype::Add Executable.gvi
diagram:
  Property Node(instance in=$"ADC Drivers") -> ("HMC8043 Driver"=w1, "DMM6500 Driver"=w2, "ICB Driver"=w3)
  case ($"Error in") {
    frame Error, Default {
      w4 = $"Error in"
    }
    frame No Error {
      Concatenate Strings("TEST:", $"Logical Instrument", " CONT,16,1") -> w5
      call "Write Command to Execute.gvi"(User Defined Read in="User Defined Read.gtype" constant, Command to Execute=w5, Error in=$"Error in") -> (User Defined Read out=w6, Error out=w7)
      call "Read Id.gvi"(Executable in=w6, Error in=w7) -> (Executable out=w8, Id=w9, Error out=w10)
      call "Write Driver.gvi"(Executable in="Measure.gtype" constant, Driver In=w2, Error in=$"Error in") -> (Executable out=w11, Error out=w12)
      call "Configure.gvi"(Measure in=w11, Function="DC Voltage", Buffer Name="mybuffer", Error in=w12) -> (Measure out=w13, Error out=w14)
      Build Array("READING", "TSTAMP") -> w15
      call "Parameter Builder.gvi"(Names=w15) -> (Parameters=w16)
      call "Write Parameters.gvi"(Executable in=w13, Parameters=w16, Error in=w14) -> (Executable out=w17, Error out=w18)
      call "Read Id.gvi"(Executable in=w17, Error in=w18) -> (Executable out=w19, Id=w20, Error out=w21)
      call "Write Volts.gvi"(Voltage in="Voltage.gtype" constant, Volts=$"Start Volts", Error in=$"Error in") -> (Voltage out=w22, Error out=w23)
      call "Write Increment.gvi"(Voltage in=w22, Increment=$Increment, Error in=w23) -> (Voltage out=w24, Error out=w25)
      call "Write Driver.gvi"(Executable in=w24, Driver In=w1, Error in=w25) -> (Executable out=w26, Error out=w27)
      # Calc stepping count
      Subtract(x=$"End Volts", y=$"Start Volts") -> w28
      Divide(x=w28, y=$Increment) -> w29
      Round Toward Positive Infinity(x=w29) -> w30
      call "Write Times Repeat.gvi"(RepeatingDirector in="RepeatingDirector.gtype" constant, Times Repeat=w30) -> (RepeatingDirector out=w31, Error out=w32)
      call "Write Wait Time.gvi"(ExecutableDirector in=w31, Wait Time=10, Error in=w32) -> (ExecutableDirector out=w33, Error out=w34)
      Merge Errors(w34, w27, w21, w10) -> (error out=w35)
      call "Add Executable.gvi"(ExecutableDirector in=w33, Executable=w26, Error in=w35) -> (ExecutableDirector out=w36, Error out=w37)
      call "Add Executable.gvi"(ExecutableDirector in=w36, Executable=w19, Error in=w37) -> (ExecutableDirector out=w38, Error out=w39)
      call "Add Executable.gvi"(ExecutableDirector in=w38, Executable=w8, Error in=w39) -> (ExecutableDirector out=w40, Error out=w4)
      $ExecutableDirector <- w40
      $"DMM MEAS Id" <- w20
      $"ADC MEAS Id" <- w9
    }
  }
  $"Error Out" <- w4
