vi "Build Command.gvi"   [LabVIEW NXG 5.0.0]
# Builds a command string up for execution on the Instrument by the Driver.  The command consists of a Base command plus any parameters that should be applied.
# This function MUST be overridden by subclasses.  The base function will return an error.
inputs:
  "Executable in": "WriteExecutable.gtype"
  "Error in": error
outputs:
  "Command": string  # Returns a properly formatted command to be sent to a Driver for execution on an Instrument.
  "Executable out": "WriteExecutable.gtype"
  "Error out": error
uses:
  Hardware Abstraction Framework::Common::WriteExecutable.gtype::Get Base Command.gvi
  Hardware Abstraction Framework::Common::WriteExecutable.gtype::Read Parameters.gvi
diagram:
  case ($"Error in") {
    frame No Error {
      call "Get Base Command.gvi"(WriteExecutable in=$"Executable in", Error in=$"Error in") -> (WriteExecutable out=w3, Base Command=w4, Error out=w5)
      call "Read Parameters.gvi"(Executable in=w3, Error in=w5) -> (Executable out=w2, Parameters=w6, Error out=w1)
      s1 = w4  # shift register
      for {
        w7 = each element of w6
        Property Node(instance in=w7) -> ("Name"=w8)
        Concatenate Strings(s1, ", ", w8) -> w9
        next s1 = w9
      }
      # Add a new line
      Concatenate Strings(s1, "\n") -> w10
      $Command <- w10
    }
    frame Error {
      w1 = $"Error in"
      w2 = $"Executable in"
    }
  }
  $"Executable out" <- w2
  $"Error out" <- w1
